# Grasshopper definition GenerativeReconSlabs-QuadTreeSubD.gh (Grasshopper 1.0.8)
# plug-ins: RhinoCodePluginGH, treesloth01, NGon, Anemone

block_thickness_basic_cross_unit = Panel("39")
multiplier = Slider(16, range=0..100)
multiplication = Multiplication(A=block_thickness_basic_cross_unit, B=multiplier)
maxpixelsize = Panel(multiplication)

number_slider = Slider(100, range=0..100)
division = Division(A=block_thickness_basic_cross_unit, B=2)
crv = Curve([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])
neg = Negative(Value=division)
loop_start = LoopStart(Repeat=0, Trigger=Button())  # -> port, Counter, Data
trigger = Trigger(Interval=-2000, TimerInterval=2000, Target=py3)  # disabled
ext = ExtendCurve(Curve=crv, Type=0, Start=neg, End=neg)
py3 = Python3Script(x=Slider(0, range=0..1000), enable=Toggle(True), reset=Button(), increment=Slider(1, range=0..1))  # -> out, a; inputs enable: Boolean, reset: Boolean
# ---------- py3: Python ----------
from Grasshopper import DataTree
if reset or 'rec' not in globals(): rec = 0
if enable: rec = rec + increment
x = rec
print (x)
# ---------- end py3 ----------
panel = Panel(loop_start.Counter)
line = Line(ext)
int = Integer(py3.a)
pframe = PerpFrame(Curve=reparameterize(line), Parameter="0")
dom = ConstructDomain(DomainStart=neg, DomainEnd=division)
Z = UnitZ(Factor=1)
panel_2 = Panel(int)
align = AlignPlane(Plane=pframe, Direction=Z)  # -> Plane, Angle

# ---- group: Random slab shapes
cluster = Cluster_8(relay_2=Slider(4, range=1..10), relay=panel)

# ----
rectangle = Rectangle(Plane=align.Plane, XSize=dom, YSize=dom, Radius=0)  # -> Rectangle, Length

# ---- group: Pixelise
cluster_2 = Cluster_7(crv=cluster, maxpixelsize=maxpixelsize)

# ----
extr = Extrude(Base=rectangle.Rectangle, Direction=line)
cap = CapHoles(Brep=extr)

# ---- group: Maxelise
cluster_3 = Cluster_5(crv=cluster_2, data=block_thickness_basic_cross_unit)  # -> brep_3, crv_19

# ----
brep = Brep(cap)
line_2 = Line(line)

brep_2 = Brep(cluster_3.brep_3)
line_3 = Line(cluster_3.crv_19)

brep_3 = Brep(brep)
line_4 = Line(line_2)

division_2 = Division(A=block_thickness_basic_cross_unit, B=2)
multiplication_2 = Multiplication(A=block_thickness_basic_cross_unit, B=Slider(2.5, range=0..10))
ext_2 = ExtendCurve(Curve=line_4, Type=0, Start=multiplication_2, End=multiplication_2)
ext_3 = ExtendCurve(Curve=line_4, Type=0, Start=division_2, End=division_2)
end = EndPoints(Curve=graft(ext_3))  # -> Start, End
end_2 = EndPoints(Curve=graft(ext_2))  # -> Start, End
lng = ListLength(List=line_4)
merge = Merge(Data1=end.Start, Data2=end.End)  # -> simplify(Result)
merge_2 = Merge(Data1=end_2.Start, Data2=end_2.End)  # -> simplify(Result)
series = Series(Start=0, Step=1, Count=lng)
concat = Concatenate(FragmentA="P", FragmentB=series)
ln = Line(StartPoint=merge, EndPoint=merge_2)  # -> simplify(Line)
brepsinc = PointInBreps(Brep=brep_3, Point=merge, Strict=invert(False))  # -> Inside, Index
brepsinc_2 = PointInBreps(Brep=brep_3, Point=merge_2, Strict=invert(False))  # -> Inside, Index
cull = CullPattern(List=brepsinc.Index, CullPattern=brepsinc.Inside)
cull_2 = CullPattern(List=ln, CullPattern=brepsinc.Inside)
cull_3 = CullPattern(List=brepsinc_2.Index, CullPattern=brepsinc.Inside)
graft = GraftTree(Tree=concat, IncludeEmptyLists=True, IncludeNullItems=True)  # -> simplify(Tree)
item = ListItem(List=concat, Index=cull_3, Wrap=invert(True))  # -> simplify(graft(Item))
item_2 = ListItem(List=concat, Index=cull, Wrap=invert(True))  # -> simplify(graft(Item))
clean = CleanTree(RemoveNulls=True, RemoveInvalid=True, RemoveEmpty=invert(False), Tree=cull_2)  # -> flatten(Tree)
propagate = PropagateAncestor(Data=item_2, Ancestors=graft)  # -> UpdatedData, PropagatedAncestors, BarrenAncestors, Orhpans
propagate_2 = PropagateAncestor(Data=item, Ancestors=graft)  # -> UpdatedData, PropagatedAncestors, BarrenAncestors, Orhpans
concat_2 = Concatenate(FragmentA=propagate.UpdatedData, FragmentB="_", FragmentC=propagate.PropagatedAncestors)
expression = Expression(x=concat_2, y=propagate_2.UpdatedData, Expression="Format(\"{0} collides {1}\", x, y)")  # -> flatten(R)
py3_2 = Python3Script(
    connections=concat_2,
    partsA=propagate.UpdatedData,
    partsB=propagate.PropagatedAncestors,
    collisions=propagate_2.UpdatedData)  # -> gml, stages_parts, stages_connections; inputs connections: tree, partsA: tree, partsB: tree, collisions: tree
# ---------- py3_2: Python ----------
# venv: recongraph
# r: recongraph @ git+https://github.com/ArdooTala/Recon_Clustering.git@rhino_gh

from ghpythonlib import treehelpers as th
import Grasshopper
import networkx as nx
from recongraph.processors import graph_solver, graph_parser
from pprint import pprint


# conns = th.tree_to_list(connections, None)
# first_parts = th.tree_to_list(partsA, None)
# second_parts = th.tree_to_list(partsB, None)
# collisions = th.tree_to_list(collisions, None)

graph = nx.DiGraph()
for conn, part_a, part_b, coll in zip(connections.Branches,
                                      partsA.Branches,
                                      partsB.Branches,
                                      collisions.Branches):
    # print(conn[0], part_a[0], part_b[0], coll[0])

    graph.add_node(conn[0], TYPE="CONN")
    graph.add_node(part_a[0], TYPE="PART")
    graph.add_node(part_b[0], TYPE="PART")
    graph.add_edge(part_a[0], conn[0], EDGE_TYPE="CONN")
    graph.add_edge(part_b[0], conn[0], EDGE_TYPE="CONN")
    if coll[0]:
        graph.add_edge(conn[0], coll[0], EDGE_TYPE="COLL")

print(graph)
gml = "\n".join(nx.generate_gml(graph))

res = graph_solver.resolve_dependencies(graph)

stages = graph_parser.add_stages(res)
components = graph_parser.add_components(res)
print(components)

stages_parts = Grasshopper.DataTree[object]()
stages_connections = Grasshopper.DataTree[object]()
for stage in components:
    for component in components[stage]:
        pth = Grasshopper.Kernel.Data.GH_Path([stage, component])

        comp = graph_parser.get_component(res, stage, component)
        print(stages, components)
        stage_parts = [n for n in comp.nodes if res.nodes.data('TYPE')[n] == "PART"]
        stage_connections = [n for n in comp.nodes if res.nodes.data('TYPE')[n] == "CONN" and res.nodes.data('latest_stage')[n] == stage]

        stages_parts.AddRange(stage_parts, pth)
        stages_connections.AddRange(stage_connections, pth)

print(stages_parts)
print(stages_connections)
# ---------- end py3_2 ----------
panel_3 = Panel(py3_2.gml)
panel_4 = Panel(expression)
mindex = MemberIndex(Set=flatten(concat_2), Member=py3_2.stages_connections)  # -> Index, Count
mindex_2 = MemberIndex(Set=concat, Member=py3_2.stages_parts)  # -> Index, Count
trim = TrimTree(Tree=mindex_2.Index, Depth=1)
trim_2 = TrimTree(Tree=mindex.Index, Depth=1)
viewer = ParamViewer(py3_2.stages_connections)
item_3 = ListItem(List=brep_3, Index=trim, Wrap=True)
item_4 = ListItem(List=line_4, Index=trim, Wrap=True)
item_5 = ListItem(List=clean, Index=trim_2, Wrap=True)

# ----
# -1 = All
component = Slider(0, range=-1..10)
stage = Slider(1, range=-1..10)
expression_2 = Expression(x=stage, y=component, Expression="Format(\"{{{0};{1}}}\", If(x<0, \"*\", x), If(y<0, \"*\", y))")

connections = Geometry(item_5)
parts_seam = Geometry(item_4)
parts_geo = Geometry(item_3)
split = SplitTree(Data=connections, Masks=flatten(expression_2))  # -> Positive, Negative
split_2 = SplitTree(Data=parts_geo, Masks=flatten(expression_2))  # -> Positive, Negative
split_3 = SplitTree(Data=parts_seam, Masks=flatten(expression_2))  # -> Positive, Negative

curvepoint = PointOnCurve(connections, parameter=1)
brepsinc_3 = PointInBreps(Brep=parts_geo, Point=curvepoint, Strict=invert(False))  # -> Inside, Index
cull_4 = CullPattern(List=connections, CullPattern=brepsinc_3.Inside)
lng_2 = ListLength(List=flatten(cull_4))
panel_5 = Panel(lng_2)
larger = LargerThan(FirstNumber=panel_5, SecondNumber="0")  # -> LargerThan, OrEqualTo

cyl = Cylinder(Base=PlaneXY(0, 0, 0), Radius=Slider(20, range=0..100), Length=split.Positive)
mesh = Mesh(cyl)
tstat = TreeStatistics(Tree=split_2.Positive)  # -> Paths, Length, Count
curvepoint_2 = PointOnCurve(split.Positive, parameter=0)
series_2 = Series(Start=0, Step=1, Count=tstat.Count)  # -> graft(Series)
msphereex = MeshSphereEx(Base=curvepoint_2, Radius=Slider(30, range=0..100), Count=5)
orient = Orient(Geometry=mesh, Source=PlaneXY(0, 0, 0), Target=split.Positive)  # -> Geometry, Transform
gradient = Gradient(
    LowerLimit=0,
    UpperLimit=tstat.Count,
    Parameter=series_2,
    stops=[0: RGB(243, 57, 0), 0.1: RGB(236, 27, 60), 0.2: RGB(210, 0, 118), 0.3: RGB(103, 0, 120), 0.4: RGB(39, 72, 161), 0.5: RGB(1, 192, 229), 0.6: RGB(18, 178, 90), 0.7: RGB(79, 186, 8), 0.8: RGB(220, 237, 32), 0.9: RGB(247, 159, 20), 1: RGB(243, 57, 0)])
offset = PolylineOffset(Curve=split_3.Positive, Distance=Slider(12, range=0..20), Divisions=0)  # -> C, H
merge_3 = Merge(Data1=offset.C, Data2=offset.H)
boundary = BoundarySurfaces(Edges=merge_3, UseTasks=True)
loop_end = LoopEnd(
    port=loop_start.port,
    Exit=larger.LargerThan,
    Data=larger.LargerThan,
    TimeOutVal=0,
    pausedState=False,
    state="Constant & Record")
preview = CustomPreview(Geometry=orient.Geometry, Material=gradient)
preview_2 = CustomPreview(Geometry=msphereex, Material=gradient)
preview_3 = CustomPreview(Geometry=split_2.Positive, Material=gradient)  # disabled
preview_4 = CustomPreview(Geometry=boundary, Material=gradient)
panel_6 = Panel(loop_end)

# ==== cluster Cluster_5
data = ClusterInput()

data_2 = Data(data)
expression = Expression(x=data_2, Expression="x*2")
expression_2 = Expression(x=data_2, Expression="x*3")
expression_3 = Expression(x=data_2, Expression="x/2")
expression_4 = Expression(x=data_2, Expression="x/4")

crv = ClusterInput()
crv_2 = Curve(crv)
dispatch = Dispatch(List=crv_2, DispatchPattern=[True, False])  # -> ListA, ListB

# ---- group: Min block length
data_3 = Data(expression_2)

# ---- group: X dir - Multi-res voxel Cells
crv_3 = Curve(dispatch.ListA)

# ---- group: Y dir - Multi-res voxel Cells
crv_4 = Curve(dispatch.ListB)

# ----
merge = Merge(Data1=crv_3, Data2=crv_4)
boundary = BoundarySurfaces(Edges=merge)
join = BrepJoin(Breps=boundary)  # -> Breps, Closed
edges = BrepEdges(Brep=join.Breps)  # -> Naked, Interior, NonManifold
crv_5 = Curve(edges.Naked)
cluster = Cluster(external_edge=crv_5, G=Toggle(False), basic_unit_wood_thickness=data_2)  # -> X_3, Y_2

# ---- group: 2D PIXEL GRID / X
crv_6 = Curve(crv_3)

# ---- group: 2D PIXEL GRID / Y
crv_7 = Curve(crv_4)

# ---- group: X - Group same dir voxels
cluster_2 = Cluster_3(crv=crv_6)

# ---- group: Y - Group same dir voxels
cluster_3 = Cluster_2(crv=crv_7)

# ---- group: Perimeter - Y
crv_8 = Curve(cluster.Y_2)

# ---- group: Perimeter - X
crv_9 = Curve(cluster.X_3)

# ---- group: Perimeter beams
entwine = Entwine(Branch00=crv_9, Branch01=crv_8, FlattenInputs=True)  # -> simplify(Result)

# ----
entwine_2 = Entwine(Branch00=cluster_2, Branch01=cluster_3, FlattenInputs=True)  # -> simplify(Result)

# ---- group: LEVEL 1 - shorten/extend frames / BASIC UNIT
data_4 = Data(data_2)

# ---- group: LEVEL 1 - shorten/extend frames
crv_10 = Curve(simplify(entwine_2))
explode = Explode(Curve=crv_10, Recursive=True)  # -> Segments, Vertices
neg = Negative(Value=data_4)
offset = OffsetCurve(Curve=explode.Segments, Distance=neg, Corners=1)

# ----
pshift = ShiftPaths(Data=offset, Offset=-1)

# ---- group: Fast way
crv_11 = Curve(pshift)
join_2 = JoinCurves(Curves=flatten(crv_11), Preserve=False)
data_5 = Data(expression_3)

# ---- group: Fast way / Voxels by stress dir
crv_12 = Curve(join_2)
X = UnitX(Factor=1)
angle = Angle(VectorA=crv_12, VectorB=X)  # -> Angle, Reflex
deg = Degrees(Radians=angle.Angle)
equals = Equality(FirstNumber=deg, SecondNumber="0")  # -> Equality, Inequality

# ---- group: Fast way (continued)
equals_2 = Equality(FirstNumber=deg, SecondNumber="180")  # -> Equality, Inequality
or = GateOr(A=equals.Equality, B=equals_2.Equality)
cull = CullPattern(List=crv_12, CullPattern=invert(or))
cull_2 = CullPattern(List=crv_12, CullPattern=or)

# ---- group: Fast way / Voxels by stress dir / X dir
crv_13 = Curve(cull_2)

# ---- group: Fast way / Voxels by stress dir / Y dir
crv_14 = Curve(cull)

# ---- group: Fast way (continued)
fix_crv_dir_y = FIXCURVEDIRZ(curve=crv_14)  # -> flatten(line_2)
fix_crv_dir_x = FIXCURVEDIRX(curve=crv_13)  # -> flatten(line_2)
join_3 = JoinCurves(Curves=fix_crv_dir_x, Preserve=False)
join_4 = JoinCurves(Curves=fix_crv_dir_y, Preserve=False)
cluster_4 = Cluster_4(C=join_3, data=data_3, data_2=data_2)
cluster_5 = Cluster_4(C=join_4, data=data_3, data_2=data_2)
brep = Brep(flatten(cluster_4))
trim = TrimWithBreps(Curve=join_4, Brep=flatten(brep))  # -> flatten(Inside), flatten(Outside)
trim_2 = TrimWithBreps(Curve=join_3, Brep=flatten(cluster_5))  # -> flatten(Inside), flatten(Outside)
crv_15 = Curve(trim_2.Outside)
ext = ExtendCurve(Curve=trim.Outside, Type=0, Start=data_5, End=data_5)
join_5 = JoinCurves(Curves=ext, Preserve=False)

number_slider = Slider(3, range=0..10)
crv_16 = Curve(crv_15)
data_6 = Data(data_2)
len = Length(Curve=crv_16)

# ----
_10º = PowerOf10(Value=number_slider)
multiplication = Multiplication(A=len, B=_10º)
multiplication_2 = Multiplication(A=data_6, B=_10º)
round = Round(Number=multiplication)  # -> Nearest, Floor, Ceiling
round_2 = Round(Number=multiplication_2)  # -> Nearest, Floor, Ceiling
division = Division(A=round.Nearest, B=_10º)
division_2 = Division(A=round_2.Nearest, B=_10º)

# ---- group: Fast way (continued)
smaller = SmallerThan(FirstNumber=division, SecondNumber=division_2)  # -> SmallerThan, OrEqualTo
cull_3 = CullPattern(List=crv_16, CullPattern=invert(smaller.OrEqualTo))

entwine_3 = Entwine(Branch00=cull_3, Branch01=join_5, FlattenInputs=True)  # -> simplify(Result)
merge_2 = Merge(Data1=entwine_3, Data2=entwine)
join_6 = JoinCurves(Curves=merge_2, Preserve=False)
cluster_6 = Cluster_4(C=join_6, data=data_3, data_2=data_2)

# ----
crv_17 = Curve(flatten(join_6))
end = EndPoints(Curve=crv_17)  # -> Start, End
ln = Line(StartPoint=end.Start, EndPoint=end.End)
brep_2 = Brep(flatten(cluster_6))
crv_18 = Curve(ln)
crv_19 = ClusterOutput(crv_18)
brep_3 = ClusterOutput(brep_2)

# ==== cluster Cluster_7
crv = ClusterInput()
crv_2 = Curve(crv)
bbox = BoundingBox(Content=crv_2, Plane=PlaneXY(0, 0, 0))  # -> Box, Box_2
debrep = DeconstructBrep(Brep=bbox.Box)  # -> Faces, Edges, Vertices
pdecon = Deconstruct(Point=debrep.Vertices)  # -> XComponent, YComponent, ZComponent
sort = SortList(Keys=pdecon.XComponent, ValuesA=debrep.Vertices)  # -> Keys, ValuesA
pdecon_2 = Deconstruct(Point=sort.ValuesA)  # -> XComponent, YComponent, ZComponent
sort_2 = SortList(Keys=pdecon_2.YComponent, ValuesA=sort.ValuesA)  # -> Keys, ValuesA
item = ListItem(List=sort_2.ValuesA, Index=0, Wrap=True)
maxpixelsize = ClusterInput()
pt = Point(item)
number_slider = Slider(8, range=0..1000)
rectangle = Rectangle(Plane=pt, XSize=maxpixelsize, YSize=maxpixelsize, Radius=0)  # -> Rectangle, Length
arrrec = RectangularArray(Geometry=rectangle.Rectangle, Cell=rectangle.Rectangle, XCount=number_slider, YCount=number_slider)  # -> Geometry, Transform

# ---- group: Quadtree Pixelise
cluster = Cluster_6(relay=arrrec.Geometry, relay_2=crv_2)

# ----
crv_3 = ClusterOutput(cluster)

# ==== cluster Cluster_8
number_slider = Slider(3000, range=0..10000)
relay = ClusterInput()
relay_2 = ClusterInput()
rectangle = Rectangle(Plane=PlaneXY(0, 0, 0), XSize=number_slider, YSize=number_slider, Radius=0)  # -> Rectangle, Length
dom = ConstructDomain(DomainStart=Slider(1000, range=0..1000), DomainEnd=Slider(2400, range=0..10000))
pop2d = Populate2D(Region=rectangle.Rectangle, Count=relay_2, Seed=relay)
lng = ListLength(List=pop2d)
random = Random(Range=dom, Number=lng, Seed=Slider(53, range=0..100))
random_2 = Random(Range=dom, Number=lng, Seed=Slider(50, range=0..100))

division = Division(A=random, B=2)
neg = Negative(Value=division)
dom_2 = ConstructDomain(DomainStart=neg, DomainEnd=division)

division_2 = Division(A=random_2, B=2)
neg_2 = Negative(Value=division_2)
dom_3 = ConstructDomain(DomainStart=neg_2, DomainEnd=division_2)

rectangle_2 = Rectangle(Plane=pop2d, XSize=dom_2, YSize=dom_3, Radius=0)  # -> Rectangle, Length
runion = RegionUnion(Curves=rectangle_2.Rectangle)
area = Area(Geometry=runion)  # -> Area, Centroid
sort = SortList(Keys=area.Area, ValuesA=runion)  # -> Keys, reverse(ValuesA)
item = ListItem(List=sort.ValuesA, Index=0, Wrap=True)
bbox = BoundingBox(Content=item, Plane=PlaneXY(0, 0, 0))  # -> Box, Box_2
area_2 = Area(Geometry=bbox.Box)  # -> Area, Centroid
neg_3 = Negative(Value=area_2.Centroid)
move = Move(Geometry=item, Motion=neg_3)  # -> Geometry, Transform
G = ClusterOutput(move.Geometry)

# ==== cluster Cluster
external_edge = ClusterInput()
basic_unit_wood_thickness = ClusterInput()
external_edge_2 = Curve(external_edge)
basic_unit_wood_thickness_2 = Data(basic_unit_wood_thickness)
G = ClusterInput()
neg = Negative(Value=basic_unit_wood_thickness_2)
expression = Expression(x=basic_unit_wood_thickness_2, Expression="x/2")
filter = StreamFilter(Gate=G, Stream0=basic_unit_wood_thickness_2, Stream1=neg)
join = JoinCurves(Curves=external_edge_2, Preserve=False)
offset = OffsetCurve(Curve=join, Distance=filter, Corners=1)
disc = Discontinuity(Curve=offset, Level=1)  # -> Points, Parameters
xy = XYPlane(Origin=Point(0, 0, 0))
shatter = Shatter(Curve=offset, Parameters=disc.Parameters)
X = UnitX(Factor=1)
angle = Angle(VectorA=shatter, VectorB=X, Plane=xy)  # -> Angle, Reflex
deg = Degrees(Radians=angle.Angle)
int = Integer(deg)
int_2 = Integer(deg)
equals = Equality(FirstNumber=int, SecondNumber=Slider(0, range=0..100))  # -> Equality, Inequality
equals_2 = Equality(FirstNumber=int_2, SecondNumber=Slider(180, range=0..1000))  # -> Equality, Inequality
addition = Addition(A=equals.Equality, B=equals_2.Equality)
cull = CullPattern(List=shatter, CullPattern=invert(addition))
cull_2 = CullPattern(List=shatter, CullPattern=addition)

# ---- group: X
crv = Curve(cull_2)

# ---- group: Y
crv_2 = Curve(cull)

# ----
data = Data(expression)
neg_2 = Negative(Value=data)
data_2 = Data(expression)
ext = ExtendCurve(Curve=crv, Type=0, Start=neg_2, End=neg_2)
ext_2 = ExtendCurve(Curve=crv_2, Type=0, Start=data_2, End=data_2)
X_2 = Curve(flatten(ext))
Y = Curve(flatten(ext_2))
X_3 = ClusterOutput(X_2)
Y_2 = ClusterOutput(Y)

# ==== cluster Cluster_2
crv = ClusterInput()

# ---- group: verticals pixels
crv_2 = Curve(crv)

# ----
explode = Explode(Curve=crv_2, Recursive=True)  # -> Segments, Vertices
crv_3 = Curve(flatten(explode.Segments))
midpt = CurveMiddle(Curve=explode.Segments)
pdecon = Deconstruct(Point=midpt)  # -> XComponent, YComponent, ZComponent
sort = SortList(Keys=pdecon.YComponent, ValuesA=midpt)  # -> Keys, ValuesA
item = ListItem(List=sort.ValuesA, Index=0, Wrap=True)  # -> Item1, Item
midpt_2 = CurveMiddle(Curve=crv_3)
ln = Line(StartPoint=item.Item1, EndPoint=item.Item)
crv_4 = Curve(flatten(ln))
join = JoinCurves(Curves=crv_4, Preserve=invert(False))
end = EndPoints(Curve=join)  # -> Start, End
cp = ClosestPoint(Point=end.Start, Cloud=midpt_2)  # -> ClosestPoint, CPIndex, Distance
ln_2 = Line(StartPoint=end.Start, EndPoint=end.End)
item_2 = ListItem(List=crv_3, Index=cp.CPIndex, Wrap=True)
len = Length(Curve=item_2)
len_2 = Length(Curve=ln_2)
dom = ConstructDomain(DomainStart=expr("-x/2", len), DomainEnd=expr("x/2", len))
dom_2 = ConstructDomain(DomainStart=expr("-x/2", len_2), DomainEnd=expr("x/2", len_2))
midpt_3 = CurveMiddle(Curve=ln_2)
rectangle = Rectangle(Plane=midpt_3, XSize=dom, YSize=dom_2, Radius=0)  # -> Rectangle, Length

# ---- group: verticals pixels - grouped
crv_5 = Curve(rectangle.Rectangle)

# ----
crv_6 = ClusterOutput(crv_5)

# ==== cluster Cluster_3
crv = ClusterInput()

# ---- group: Horizontal pixels
crv_2 = Curve(crv)

# ----
explode = Explode(Curve=crv_2, Recursive=True)  # -> Segments, Vertices
crv_3 = Curve(flatten(explode.Segments))
midpt = CurveMiddle(Curve=explode.Segments)
pdecon = Deconstruct(Point=midpt)  # -> XComponent, YComponent, ZComponent
sort = SortList(Keys=pdecon.XComponent, ValuesA=midpt)  # -> Keys, ValuesA
item = ListItem(List=sort.ValuesA, Index=0, Wrap=True)  # -> Item1, Item
ln = Line(StartPoint=item.Item1, EndPoint=item.Item)
crv_4 = Curve(flatten(ln))
join = JoinCurves(Curves=crv_4, Preserve=invert(False))
midpt_2 = CurveMiddle(Curve=crv_3)
end = EndPoints(Curve=join)  # -> Start, End
cp = ClosestPoint(Point=end.Start, Cloud=midpt_2)  # -> ClosestPoint, CPIndex, Distance
item_2 = ListItem(List=crv_3, Index=cp.CPIndex, Wrap=True)
len = Length(Curve=item_2)
dom = ConstructDomain(DomainStart=expr("-x/2", len), DomainEnd=expr("x/2", len))
ln_2 = Line(StartPoint=end.Start, EndPoint=end.End)
midpt_3 = CurveMiddle(Curve=ln_2)
len_2 = Length(Curve=ln_2)
dom_2 = ConstructDomain(DomainStart=expr("-x/2", len_2), DomainEnd=expr("x/2", len_2))
rectangle = Rectangle(Plane=midpt_3, XSize=dom_2, YSize=dom, Radius=0)  # -> Rectangle, Length

# ---- group: horizontal pixels - grouped
crv_5 = Curve(rectangle.Rectangle)

# ----
crv_6 = ClusterOutput(crv_5)

# ==== cluster FIXCURVEDIRX
curve = ClusterInput()
end_points = EndPoints(Curve=curve)  # -> Start, End
deconstruct = Deconstruct(Point=graft(end_points.Start))  # -> XComponent, YComponent, ZComponent
deconstruct_2 = Deconstruct(Point=graft(end_points.End))  # -> XComponent, YComponent, ZComponent
merge = Merge(Data1=graft(end_points.Start), Data2=graft(end_points.End))
minimum = Minimum(A=deconstruct.XComponent, B=deconstruct_2.XComponent)
deconstruct_3 = Deconstruct(Point=merge)  # -> XComponent, YComponent, ZComponent
equality = Equality(FirstNumber=deconstruct_3.XComponent, SecondNumber=minimum)  # -> Equality, Inequality
cull_pattern = CullPattern(List=merge, CullPattern=invert(equality.Equality))
cull_pattern_2 = CullPattern(List=merge, CullPattern=equality.Equality)
line = Line(StartPoint=cull_pattern_2, EndPoint=cull_pattern)  # -> simplify(Line)
end_points_2 = EndPoints(Curve=line)  # -> simplify(Start), simplify(End)
pt = Point(end_points_2.Start)
pt_2 = Point(end_points_2.End)
line_2 = ClusterOutput(line)

# ==== cluster FIXCURVEDIRZ: AK components
curve = ClusterInput()
end_points = EndPoints(Curve=curve)  # -> Start, End
deconstruct = Deconstruct(Point=graft(end_points.Start))  # -> XComponent, YComponent, ZComponent
deconstruct_2 = Deconstruct(Point=graft(end_points.End))  # -> XComponent, YComponent, ZComponent
merge = Merge(Data1=graft(end_points.Start), Data2=graft(end_points.End))
minimum = Minimum(A=deconstruct.YComponent, B=deconstruct_2.YComponent)
deconstruct_3 = Deconstruct(Point=merge)  # -> XComponent, YComponent, ZComponent
equality = Equality(FirstNumber=deconstruct_3.YComponent, SecondNumber=minimum)  # -> Equality, Inequality
cull_pattern = CullPattern(List=merge, CullPattern=invert(equality.Equality))
cull_pattern_2 = CullPattern(List=merge, CullPattern=equality.Equality)
line = Line(StartPoint=cull_pattern_2, EndPoint=cull_pattern)  # -> simplify(Line)
end_points_2 = EndPoints(Curve=line)  # -> simplify(Start), simplify(End)
pt = Point(end_points_2.Start)
pt_2 = Point(end_points_2.End)
line_2 = ClusterOutput(line)

# ==== cluster Cluster_4
data = ClusterInput()
data_2 = ClusterInput()
C = ClusterInput()

data_3 = Data(data)
data_4 = Data(data_2)
expression = Expression(x=data_3, Expression="x/2")
expression_2 = Expression(x=data_4, Expression="x/2")
neg = Negative(Value=expression)
neg_2 = Negative(Value=expression_2)
dom = ConstructDomain(DomainStart=neg, DomainEnd=expression)
pframes = PerpFrames(Curve=C, Count=Slider(1, range=0..1), Align=True)  # -> Frames, Parameters
dom_2 = ConstructDomain(DomainStart=neg_2, DomainEnd=expression_2)
rectangle = Rectangle(Plane=pframes.Frames, XSize=dom, YSize=dom_2, Radius=0)  # -> Rectangle, Length
loft = Loft(
    Curves=rectangle.Rectangle,
    Options={Adjust=False, Closed=False, LoftEnds=0, LoftSimp=0, LoftType=0, Rebuild=10, Refit=0.01})
cap = CapHoles(Brep=loft)

B = ClusterOutput(cap)

# ==== cluster Cluster_6
relay = ClusterInput()
relay_2 = ClusterInput()

crv = Curve(simplify(graft(relay)))
disc = Discontinuity(Curve=relay, Level=1)  # -> simplify(Points), Parameters
incurve = PointInCurve(Point=disc.Points, Curve=relay_2)  # -> simplify(Relationship), Point
ma = MassAddition(Input=incurve.Relationship)  # -> Result, PartialResults
larger = LargerThan(FirstNumber=ma.Result, SecondNumber=Slider(6, range=0..10))  # -> LargerThan, OrEqualTo
cull = CullPattern(List=crv, CullPattern=invert(larger.LargerThan))
cull_2 = CullPattern(List=crv, CullPattern=larger.LargerThan)

number_slider = Slider(2, range=0..10)
boundary = BoundarySurfaces(Edges=cull)
divide = DivideDomain²(Domain=boundary, UCount=number_slider, VCount=number_slider)
subsrf = Isotrim(Surface=boundary, Domain=divide)  # -> simplify(Surface)
edges = BrepEdges(Brep=subsrf)  # -> Naked, Interior, NonManifold
join = JoinCurves(Curves=edges.Naked, Preserve=False)  # -> simplify(flatten(Curves))

crv_2 = Curve(simplify(graft(join)))
disc_2 = Discontinuity(Curve=join, Level=1)  # -> simplify(Points), Parameters
incurve_2 = PointInCurve(Point=disc_2.Points, Curve=relay_2)  # -> simplify(Relationship), Point
ma_2 = MassAddition(Input=incurve_2.Relationship)  # -> Result, PartialResults
larger_2 = LargerThan(FirstNumber=ma_2.Result, SecondNumber=Slider(6, range=0..10))  # -> LargerThan, OrEqualTo
cull_3 = CullPattern(List=crv_2, CullPattern=invert(larger_2.LargerThan))
cull_4 = CullPattern(List=crv_2, CullPattern=larger_2.LargerThan)

number_slider_2 = Slider(2, range=0..10)
boundary_2 = BoundarySurfaces(Edges=cull_3)
divide_2 = DivideDomain²(Domain=boundary_2, UCount=number_slider_2, VCount=number_slider_2)
subsrf_2 = Isotrim(Surface=boundary_2, Domain=divide_2)  # -> simplify(Surface)
edges_2 = BrepEdges(Brep=subsrf_2)  # -> Naked, Interior, NonManifold
join_2 = JoinCurves(Curves=edges_2.Naked, Preserve=False)  # -> simplify(flatten(Curves))

crv_3 = Curve(simplify(graft(join_2)))
disc_3 = Discontinuity(Curve=join_2, Level=1)  # -> simplify(Points), Parameters
incurve_3 = PointInCurve(Point=disc_3.Points, Curve=relay_2)  # -> simplify(Relationship), Point
ma_3 = MassAddition(Input=incurve_3.Relationship)  # -> Result, PartialResults
larger_3 = LargerThan(FirstNumber=ma_3.Result, SecondNumber=Slider(6, range=0..10))  # -> LargerThan, OrEqualTo
cull_5 = CullPattern(List=crv_3, CullPattern=invert(larger_3.LargerThan))
cull_6 = CullPattern(List=crv_3, CullPattern=larger_3.LargerThan)

merge = Merge(Data1=cull_2, Data2=cull_4, Data3=cull_6)  # -> flatten(Result)
crv_4 = Curve(merge)
crv_5 = ClusterOutput(crv_4)
