# Grasshopper definition Recon_Clustering.gh (Grasshopper 1.0.8)
# plug-ins: RhinoCodePluginGH, treesloth01

crv = Curve([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])
number_slider = Slider(4, range=0..10)
lng = ListLength(List=crv)
pln = Plane(crv)
line = Line(crv)
series = Series(Start=0, Step=1, Count=lng)
rectangle = Rectangle(Plane=pln, XSize=Domain(-1, 1), YSize=Domain(-1, 1), Radius=0)  # -> Rectangle, Length
ext = ExtendCurve(Curve=line, Type=0, Start=number_slider, End=number_slider)
end = EndPoints(Curve=graft(line))  # -> Start, End
end_2 = EndPoints(Curve=graft(ext))  # -> Start, End
concat = Concatenate(FragmentA="P", FragmentB=series)
extr = Extrude(Base=rectangle.Rectangle, Direction=line)
merge = Merge(Data1=end.Start, Data2=end.End)
merge_2 = Merge(Data1=end_2.Start, Data2=end_2.End)
cap = CapHoles(Brep=extr)
ln = Line(StartPoint=merge, EndPoint=merge_2)  # -> simplify(Line)
brepsinc = PointInBreps(Brep=cap, Point=merge, Strict=invert(False))  # -> Inside, Index
brepsinc_2 = PointInBreps(Brep=cap, Point=merge_2, Strict=invert(False))  # -> Inside, Index
cull = CullPattern(List=brepsinc_2.Index, CullPattern=brepsinc.Inside)
cull_2 = CullPattern(List=brepsinc.Index, CullPattern=brepsinc.Inside)
cull_3 = CullPattern(List=ln, CullPattern=brepsinc.Inside)
graft = GraftTree(Tree=concat, IncludeEmptyLists=True, IncludeNullItems=True)  # -> simplify(Tree)
item = ListItem(List=concat, Index=cull_2, Wrap=invert(True))  # -> simplify(graft(Item))
item_2 = ListItem(List=concat, Index=cull, Wrap=invert(True))  # -> simplify(graft(Item))
propagate = PropagateAncestor(Data=item, Ancestors=graft)  # -> UpdatedData, PropagatedAncestors, BarrenAncestors, Orhpans
clean = CleanTree(RemoveNulls=True, RemoveInvalid=True, RemoveEmpty=invert(False), Tree=cull_3)  # -> flatten(Tree)
propagate_2 = PropagateAncestor(Data=item_2, Ancestors=graft)  # -> UpdatedData, PropagatedAncestors, BarrenAncestors, Orhpans
concat_2 = Concatenate(FragmentA=propagate.UpdatedData, FragmentB="_", FragmentC=propagate.PropagatedAncestors)
py3 = Python3Script(
    connections=concat_2,
    partsA=propagate.UpdatedData,
    partsB=propagate.PropagatedAncestors,
    collisions=propagate_2.UpdatedData)  # -> gml, stages_parts, stages_connections; inputs connections: tree, partsA: tree, partsB: tree, collisions: tree
# ---------- py3: Python ----------
# venv: recongraph
# r: recongraph @ git+https://github.com/ArdooTala/Recon_Clustering.git@main

from ghpythonlib import treehelpers as th
import networkx as nx
from recongraph.processors import graph_solver, graph_parser
from pprint import pprint


# conns = th.tree_to_list(connections, None)
# first_parts = th.tree_to_list(partsA, None)
# second_parts = th.tree_to_list(partsB, None)
# collisions = th.tree_to_list(collisions, None)

graph = nx.DiGraph()
for conn, part_a, part_b, coll in zip(connections.Branches,
                                      partsA.Branches,
                                      partsB.Branches,
                                      collisions.Branches):
    print(conn[0], part_a[0], part_b[0], coll[0])

    graph.add_node(conn[0], TYPE="CONN")
    graph.add_node(part_a[0], TYPE="PART")
    graph.add_node(part_b[0], TYPE="PART")
    graph.add_edge(part_a[0], conn[0], EDGE_TYPE="CONN")
    graph.add_edge(part_b[0], conn[0], EDGE_TYPE="CONN")
    if coll[0]:
        graph.add_edge(conn[0], coll[0], EDGE_TYPE="COLL")

print(graph)

res = graph_solver.direct_cluster_sccs(graph)

res_xpn = graph_solver.expand_clusters(res)

stages = graph_parser.generate_stages_v2(res_xpn)
stages_dict = graph_parser.extract_stages(graph, stages)
pprint(stages_dict)

stages_part_list = []
stages_conn_list = []
for stg in stages_dict:
    stg_part_comps = []
    stg_conn_comps = []
    for comp in stages_dict[stg]:
        stg_part_comps.append(list(stages_dict[stg][comp]['group']))
        stg_conn_comps.append(list(stages_dict[stg][comp]['conns']))
    stages_part_list.append(stg_part_comps)
    stages_conn_list.append(stg_conn_comps)

stages_parts = th.list_to_tree(stages_part_list, source=[0])
stages_connections = th.list_to_tree(stages_conn_list, source=[0])
# ---------- end py3 ----------
panel = Panel(concat_2)
panel_2 = Panel(propagate.UpdatedData)
panel_3 = Panel(propagate.PropagatedAncestors)
mindex = MemberIndex(Set=concat, Member=py3.stages_parts)  # -> Index, Count
mindex_2 = MemberIndex(Set=flatten(concat_2), Member=py3.stages_connections)  # -> Index, Count
panel_4 = Panel(propagate_2.UpdatedData)
panel_5 = Panel(py3.stages_parts)
trim = TrimTree(Tree=mindex.Index, Depth=1)
trim_2 = TrimTree(Tree=mindex_2.Index, Depth=1)
item_3 = ListItem(List=cap, Index=trim, Wrap=True)
item_4 = ListItem(List=clean, Index=trim_2, Wrap=True)
viewer = ParamViewer(panel_5)
tstat = TreeStatistics(Tree=item_3)  # -> Paths, Length, Count
item_5 = ListItem(List=tstat.Paths, Index=Slider(15, range=0..20), Wrap=invert(True))
panel_6 = Panel(tstat.Count)
branch = TreeBranch(Tree=item_3, Path=item_5, MaintainPaths=True)
branch_2 = TreeBranch(Tree=item_4, Path=item_5, MaintainPaths=True)
stage = Panel(item_5)
parts = Geometry(branch)
connections = Geometry(branch_2)
